# Grasshopper definition basic_cylindar.gh (Grasshopper 1.0.7)

cylinder = Cylinder(Base=PlaneXY(0, 0, 0), Radius=Slider(5, range=0..100), Length=1)
contour = Contour(Shape=cylinder, Point=Point(0, 0, 0), Direction=Vector(0, 0, 1), Distance=Slider(1, range=0.5..8))
points = Slider(42, range=0..100)
divide_curve = DivideCurve(Curve=contour, Count=points, Kinks=False)  # -> Points, Tangents, Parameters
flatten_tree = FlattenTree(Tree=divide_curve.Points, Path="{0}")
polyline = PolyLine(Vertices=flatten_tree, Closed=False)
explode = Explode(Curve=polyline, Recursive=True)  # -> Segments, Vertices
deconstruct = Deconstruct(Point=flatten_tree)  # -> XComponent, YComponent, ZComponent
length = Length(Curve=explode.Segments)
concatenate = Concatenate(
    FragmentA="G1 F1800 ",
    FragmentB="X",
    FragmentC=deconstruct.XComponent,
    FragmentD=" Y",
    FragmentE=deconstruct.YComponent,
    FragmentF=" Z",
    FragmentG=deconstruct.ZComponent,
    FragmentH=" E",
    FragmentI=length)
panel = Panel(concatenate)
panel_2 = Panel(""";START GCODE

; ***************""")
merge = Merge(Data1=panel_2, Data2=panel, Data3=";END GCODE")
panel_3 = Panel(merge)
