# Grasshopper definition class_tutorial.gh (Grasshopper 1.0.8)

cylinder = Cylinder(Base=PlaneXY(0, 0, 0), Radius=Slider(25, range=5..100), Length=Slider(50, range=10..200))
contour = Contour(Shape=cylinder, Point=Point(0, 0, 0), Direction=Vector(0, 0, 1), Distance=Slider(1.5, range=0.5..5))
divide_curve = DivideCurve(Curve=contour, Count=Slider(42, range=12..60), Kinks=False)  # -> Points, Tangents, Parameters
flatten_tree = FlattenTree(Tree=divide_curve.Points, Path="{0}")
polyline = PolyLine(Vertices=flatten_tree, Closed=False)
deconstruct = Deconstruct(Point=flatten_tree)  # -> XComponent, YComponent, ZComponent
explode = Explode(Curve=polyline, Recursive=True)  # -> Segments, Vertices
length = Length(Curve=explode.Segments)
concatenate = Concatenate(
    Fragment_A="G1 F1800",
    X=" X",
    X_value=deconstruct.XComponent,
    Y=" Y",
    Y_value=deconstruct.YComponent,
    Z=" Z",
    Z_value=deconstruct.ZComponent,
    E=" E",
    E_value=length)
panel = Panel(concatenate)
panel_2 = Panel(""";FLAVOR:Marlin
;TIME:1000
;Filament used: 66.7047m
;Layer height: 1.5
;MINX:-63.615
;MINY:-61.575
;MINZ:1.5
;MAXX:63.596
;MAXY:61.581
;MAXZ:95.344
;TARGET_MACHINE.NAME:Unknown
;Generated with Cura_SteamEngine 5.6.0
M105
M109 S0
M83 ; relative extrusion mode

G92 E0
G92 E0
;LAYER_COUNT:63
;LAYER:0
M107""")
panel_3 = Panel("""G91; relative positioning 
G0 X300 Z100 F1200; reposition nozzle
G1 E-1000 F20000; retract extruder, move head
G90; absolute positioning
M82 ;absolute extrusion mode
;End of Gcode""")
merge = Merge(Data1=graft([panel_2, panel, panel_3]))  # -> flatten(Result)
panel_4 = Panel(merge)
